% Simulink data dictionary modelDictionary.sldd

Ts = 1.0e-6
Motor_Pn = 4
Var = 0.00012
Sig = Simulink.Signal()  % 0.00012
Motor_Rs = 0.958
Motor_Ld_Indctances = 0.012
Motor_Lq_Indctances = 0.012
SysVoltage = 500
DTC_Flux_Predict = 0
Motor_flux = 0.1827

BAK = Simulink.Signal(DataType="double")  % 0.00525
  % 0.012
  % 0.958
  % 0.1827

MPTA_SubSysCtrl = 0
switch_electronic_feedworward = 1
MPTA_Way = 0
Motor_Observer = 0
Switch_SubsysCtrl = 5
SysCurrentMax = 20